# Grasshopper definition DAY02-Homework.ghx (Grasshopper 1.0.7)
# Copyright: Alan Rynne

# ---- group: Big Attractor Exercise
pt = Point([Point(0.3037832804, 0.474872937, -0.3378564818), Point(0.4721519081, 2.198995174, 0.506820065), Point(1.216226153, 0.9344408599, -0.271656236), Point(1.981215506, 0.6377761895, 0.1286148111), Point(1.230417757, -0.1119027715, 0.2289347743)])
series = Series(Start=0, Step="0.1", Count=Slider(21, range=0..100))
pt_2 = ConstructPoint(XCoordinate=graft(series), YCoordinate=series, ZCoordinate=0)  # -> simplify(Point)
pi = Pi(Factor=Slider(0.07, range=0..1))
colors = Relay([ColourSwatch(SwatchColor=RGB(0, 150, 143)), ColourSwatch(SwatchColor=RGB(255, 0, 0)), ColourSwatch(SwatchColor=RGB(0, 92, 138))])
dom = ConstructDomain(DomainStart=Slider(0.00884, range=0..0.05), DomainEnd=Slider(0.05, range=0..0.05))
python = GhPythonScript(point=pt_2, attractors=pt, maxRot=pi, radiusRange=dom, ratio=Slider(0.1332, range=0..0.3), colorList=colors)  # -> out, shape, color, brep; inputs point: Point3d, attractors: list of Point3d, colorList: list of Point3d
# ---------- python: Python ----------
import Rhino.Geometry as rg
import Rhino.Display as rd
import math
import random

# 1. Get the closest attractor point

# 1.1 Create a point cloud from the attractors
cloud = rg.PointCloud(attractors)

# 1.2 Get the index of the closest point in the point cloud
attractorIndex = cloud.ClosestPoint(point)

# 1.3 Get the point in the attractors list at that index
attractor = attractors[attractorIndex]


# 2. Compute the distance from the attractor to this point


# 3. Compute the radius

# 3.1 Divide the ratio / (distance * 10), this will make the attractor inverse.

# 3.2 Prevent radius from being bigger or smaller than desired.

# 4. Get the ratio of the radius in that range (number from 0 to 1).


# 5. Compute the rotation of the plane in radians


# 6. Create a plane at the point and rotate it


# 7. Decide if you draw a circle or a square based on the radius value.


# 8. Create brep from closed planar curve

# 8.1 Use an rg.Brep function to 'CreatePlanarBreps'

# 8.2 'planarResult' is a LIST, so we get the first item and assign to output

# 9. Compute a color based on the radius.

# 9.1 Create a curve from the color points

# 9.2 Compute a color based on the radiusRatio and assign to output


# 10. Modify this in your own way to make it unique! :D
# ---------- end python ----------
preview = CustomPreview(Geometry=python.brep, Material=python.color)

# ---- group: Format strings
# PYTHON - DAY 02 - HOMEWORK
panel = Panel("""UPC
MIT""")
panel_2 = Panel("""Introduction to Python
Digital Fabrication""")
python_2 = GhPythonScript(name="John", surname="Doe", university=panel, subject=panel_2)  # -> out, fullName, greeting, inscription
# ---------- python_2: Python ----------
# STRING FORMATTING

# All of these steps must be done with the '.format()' function.

# 1. Create the full name of a student in the form: "NAME SURNAME"


# 2. Create a greeting in the form: "Hello FULLNAME! Welcome to SUBJECT!


# 3. Create a phrase depicting what is a student studying and where.
# In the form of: "FULLNAME is a student in UNIVERSITY, studying SUBJECT"


## 4. If the student university is "UPC" or "MPDA", add an extra message at the end of the greeting.
## Saying: "See you in Barcelona in June!"
# ---------- end python_2 ----------
panel_3 = Panel(python_2.greeting)

# ---- group: Filtering with conditionals
range = Range(Domain=Domain(0, 1), Steps=Slider(7, range=0..10))
Z = UnitZ(Factor=range)
pt_3 = ConstructPoint(XCoordinate=graft(range), YCoordinate=range, ZCoordinate=0)
move = Move(Geometry=simplify(graft(pt_3)), Motion=Z)  # -> simplify(Geometry), Transform
point = GhPythonScript(point=move.Geometry)  # -> out, a, b, c; inputs point: Point3d
# ---------- point: Python ----------
# 1. Assign to output 'a' the point if it has a Z coordinate
# bigger or equals to '0.5'


# 2. Assign to output 'b' the point if it has:
    # X coordinate smaller than 0.3
    # AND
    # Y coordinate bigger or equals to 0.8


# Create a new input of Plane type in GH and input some plane in it.

# Compute the distance from the point to the plane.


# 3. Assign to output 'c' all points that:
    # Have a distance to the plane greater than 0.3
    # AND
        # Have an X coordinate smaller than .7
        # OR
        # Have a Y coordinate bigger than .3


# 4. Assign to ouptut 'd' any point that does not match part 3.
# ---------- end point ----------
