# Grasshopper definition Day01-END.ghx (Grasshopper 1.0.7)

panel = Panel("""Smith
Johnson
O’Reilly
Chang
Sanchez
Doe""")
panel_2 = Panel("""John
Michael
Patrick
Sue
Mary
Jane""")
panel_3 = Panel("Smith")
panel_4 = Panel("John")
python = GhPythonScript(name=panel_2, surname=panel)  # -> out, greeting
# ---------- python: Python ----------
print(name)
print(surname)

# We want to create a greeting in the form of
# 'Hello FULLNAME, welcome to Python Programming!'

# First we create a variable for the full name
# We can add strings of text together with + signs
fullName = name + ' ' + surname

# Then we create the greeting with the full name
greeting = 'Hi ' + fullName + ', welcome to python programming!'
# ---------- end python ----------
panel_5 = Panel(python.greeting)

pi = Pi(Factor=2)
range = Range(Domain=pi, Steps=10)
pi_2 = Pi(Factor=Slider(2, range=0..2))
python_2 = GhPythonScript(t=pi_2, r=Slider(1, range=0..1))  # -> out, pt
# ---------- python_2: Python ----------
# USING OTHER LIBRARIES

# Complex functionalities in python are divided into libraries
# If you want to use a specific library in your scripts,
# you must first import it.

# Let's import the math library
import math


a = 0 # 'a' is the x coordinate of the center of the circle
b = 0 # 'b' is the y coordinate of the center of the circle

# Use equations from https://en.wikipedia.org/wiki/Circle
# in the 'Parametric Form' section.
x = a + r * math.cos(t)
y = b + r * math.sin(t)

print(x,y)

# These are only numbers for now, lets import the Rhino library
import Rhino.Geometry as rg

# Create a 3d point using the computed x and y variables.
pt = rg.Point3d(x,y,0)
# ---------- end python_2 ----------
panel_6 = Panel(python_2.out)

range_2 = Range(Domain=Domain(0, 1), Steps=Slider(10, range=0..10))
pt = ConstructPoint(XCoordinate=graft(range_2), YCoordinate=range_2, ZCoordinate=0)
pt_2 = Point(Point(0.9634185682, 0.4892154751, 0.05846322429))
python_3 = GhPythonScript(point=pt, attractor=pt_2)  # -> out, circle, line, extrude; inputs point: Point3d, attractor: Point3d
# ---------- python_3: Python ----------
import Rhino.Geometry as rg

# Get the distance between the point and the attractor
distance = point.DistanceTo(attractor)

# Distance is usually too big to use as a radius, so divide by 10 (or whatever)
ratio = distance / 10

# Create a circle using point and ratio
circle = rg.Circle(point,ratio)

# Create a vector in the z direction
move = rg.Vector3d.ZAxis * distance

# Move the point using the prevously created vector
end = point + move

# Create a line between both points
line = rg.Line(point,end)

# Creating breps - Sweep
# Sweep requires to inputs as 'curves', so we must convert the line and the circle first
lineCrv = line.ToNurbsCurve()
circleCrv = circle.ToNurbsCurve()

# Create the sweep brep.
breps = rg.Brep.CreateFromSweep(lineCrv,circleCrv,False,0.01)
brep = breps[0]

closedBrep = rg.Brep.CapPlanarHoles(brep,0.00001)

# Assign brep to output
extrude = closedBrep
# ---------- end python_3 ----------

# ---- group: Extra
pt_3 = Point(Point(3.090023578, 6.615720864, 7.427535167))
repeat = RepeatData(Data=Slider(1, range=0..1), Length=Slider(10, range=0..100))
python_4 = GhPythonScript(radius=repeat, max=Slider(10, range=0..100), attractor=pt_3)  # -> out, sphere; inputs attractor: Point3d
# ---------- python_4: Python ----------
import math
import Rhino.Geometry as rg
import random

# TIP
# Use `random.randrange(min,max)` to get a random number 
# between a given interval

# Compute the individual x,y and z coordinates
x = random.randrange(0,max)
y = random.randrange(0,max)
z = random.randrange(0,max)

# Create a point with those coordinates
center = rg.Point3d(x,y,z)

# Compute the distance between the center 
# and the attractor point
distance = center.DistanceTo(attractor)

# Modify the radius in some way
# for example, multiply by the distance and divide it by the 'max'
ratio = radius * distance / max

# Create a sphere
sphere = rg.Sphere(center,ratio)
# ---------- end python_4 ----------

# ----
python_5 = GhPythonScript()  # -> out, a
# ---------- python_5: Python ----------
# PYTHON BASICS

# This is a comment
# A comment is anything after a '#' character


# The print function
# It will write a new item into 'out' 
print('Hello, MPDA!')


# VARIABLES
# Variables are placeholders for different types of data.

# -- String variable
name = 'Alan Rynne'
print(name)


# -- Number variable
number = 153.22
print(number)


# -- Boolean variable
active = True
print(active)
active = False
print(active)

# -- List variable
# You can create lists by enclosing variables 
# or values separated by commas around square brackets

numbers = [0,1,2,3,4,5,6] # This is a list of numbers
print(numbers)

# You can access list items by index (starting in 0, just like GH)
print(numbers[0])


# -- Variables can have any name, even long ones
s = "I'm very short"
aVariableName = "I'm not very long..."
aVeryVeryVeryVeryVeryLongVariableName = "I'm long..."

print(s)
print(aVariableName)
print(aVeryVeryVeryVeryVeryLongVariableName)

# -- Variable names are CASE SENSITIVE
myname = "Alan"
myName = "Christian"

# 'myname' and 'myName' will be two different, independent variables with different values.
print(myname,myName)
# This is one of the main cause of errors when starting programming in Python. Always check spelling.
# ---------- end python_5 ----------
panel_7 = Panel(python_5.out)

range_3 = Range(Domain=Domain(0, 1), Steps=Slider(10, range=0..10))
pt_4 = Point(Point(0.5087040954, 0.4892154751, -0.0007580647143))
pt_5 = ConstructPoint(XCoordinate=graft(range_3), YCoordinate=range_3, ZCoordinate=0)

dist = Distance(PointA=pt_5, PointB=pt_4)
Z = UnitZ(Factor=dist)
division = Division(A=dist, B="10")
addition = Addition(A=pt_5, B=Z)
cir = Circle(Plane=pt_5, Radius=division)
ln = Line(StartPoint=pt_5, EndPoint=addition)
extrcrv = ExtrudeAlong(Base=cir, Curve=ln)
cap = CapHoles(Brep=extrcrv)

brep = Brep(cap)
circle = Circle(cir)
line = Line(ln)

number_slider = Slider(1.012, range=0..10)
pi_3 = Pi(Factor=Slider(0.9027, range=0..2))

# ---- group: GH Equivalent
center_x_coord = Slider(0, range=0..100)
center_y_coord = Slider(0, range=0..100)
expression = Expression(b=center_y_coord, r=number_slider, t=pi_3, Expression="b + r * Sin(t)")
expression_2 = Expression(a=center_x_coord, r=number_slider, t=pi_3, Expression="a + r * Cos(t)")
pt_6 = ConstructPoint(XCoordinate=expression_2, YCoordinate=expression, ZCoordinate=0)

# ----
pt_7 = Point(pt_6)

panel_8 = Panel("""John
Michael
Patrick
Sue
Mary
Jane""")
panel_9 = Panel("""Smith
Johnson
O’Reilly
Chang
Sanchez
Doe""")

# ---- group: GH Equivalent
space = Panel(" ")
concat = Concatenate(FragmentA="John", FragmentB=space, FragmentC="Smith")
fullname = Panel(concat)
concat_2 = Concatenate(FragmentA="Hello", FragmentB=space, FragmentC=concat, FragmentD="! Welcome to Python Programming!")

# ----
panel_10 = Panel(concat_2)
