# Grasshopper definition Day01-START.ghx (Grasshopper 1.0.7)

panel = Panel("""Smith
Johnson
O’Reilly
Chang
Sanchez
Doe""")
panel_2 = Panel("""John
Michael
Patrick
Sue
Mary
Jane""")
python = GhPythonScript(name="John", surname="Smith")  # -> out, greeting
# ---------- python: Python ----------
print(name)
print(surname)

# We want to create a greeting in the form of
# 'Hello FULLNAME, welcome to Python Programming!'

# 1. First we create a variable for the full name
# We can add strings of text together with + signs

# 2. Then we create the personalized greeting with the full name

# 3. Assign it to the 'greeting' output
# ---------- end python ----------
panel_3 = Panel(python.greeting)

pi = Pi(Factor=2)
range = Range(Domain=pi, Steps=10)
pi_2 = Pi(Factor=Slider(2, range=0..2))
python_2 = GhPythonScript(t=pi_2, r=Slider(1, range=0..1))  # -> out, pt
# ---------- python_2: Python ----------
# USING OTHER LIBRARIES

# Complex functionalities in python are divided into libraries
# If you want to use a specific library in your scripts,
# you must first import it.

# Let's try and create one point around a circle.

# 1. Let's import the math library
# import math


# 2. Use equations from https://en.wikipedia.org/wiki/Circle
# in the 'Parametric Form' section.


# TIP
# These are only numbers for now, lets import the Rhino library.
# To use it you first need to import it
# import Rhino.Geometry as rg


# 3. Create a 3d point using the computed x and y variables.
#
# ---------- end python_2 ----------
panel_4 = Panel(python_2.out)

range_2 = Range(Domain=Domain(0, 1), Steps=Slider(10, range=0..10))
pt = ConstructPoint(XCoordinate=graft(range_2), YCoordinate=range_2, ZCoordinate=0)
pt_2 = Point(Point(0.9634185682, 0.4892154751, 0.05846322429))
python_3 = GhPythonScript(point=pt, attractor=pt_2)  # -> out, circle, line, extrude; inputs point: Point3d, attractor: Point3d
# ---------- python_3: Python ----------
import Rhino.Geometry as rg

# We are going to create a simple 'attractor' exercise. 
# Given a point from a grid and an attractor point:

# 1. Get the distance between the point and the attractor

# 2. Distance is usually too big to use as a radius, so divide by 10 (or whatever)

# 3. Create a circle using point and ratio

# 4. Create a vector in the z direction

# 5. Move the point using the prevously created vector

# 6. Create a line between both points

# TIP
# Sweep requires to inputs as 'curves', so we must convert the line and the circle first

# 8. Create the sweep brep.

# 8.1. Optionally closed the planar holes in the extrusion.

# 9. Assign brep to output
# ---------- end python_3 ----------

python_4 = GhPythonScript()  # -> out, a
# ---------- python_4: Python ----------
# PYTHON BASICS

# This is a comment
# A comment is anything after a '#' character


# The print function
# It will write a new item into 'out' 
print('Hello, MPDA!')


# VARIABLES
# Variables are placeholders for different types of data.

# -- String variable
name = 'Alan Rynne'
print(name)


# -- Number variable
number = 153.22
print(number)


# -- Boolean variable
active = True
print(active)
active = False
print(active)

# -- List variable
# You can create lists by enclosing variables 
# or values separated by commas around square brackets

numbers = [0,1,2,3,4,5,6] # This is a list of numbers
print(numbers)

# You can access list items by index (starting in 0, just like GH)
print(numbers[0])


# -- Variables can have any name, even long ones
s = "I'm very short"
aVariableName = "I'm not very long..."
aVeryVeryVeryVeryVeryLongVariableName = "I'm long..."

print(s)
print(aVariableName)
print(aVeryVeryVeryVeryVeryLongVariableName)

# -- Variable names are CASE SENSITIVE
myname = "Alan"
myName = "Christian"

# 'myname' and 'myName' will be two different, independent variables with different values.
print(myname,myName)
# This is one of the main cause of errors when starting programming in Python. Always check spelling.
# ---------- end python_4 ----------
panel_5 = Panel(python_4.out)

range_3 = Range(Domain=Domain(0, 1), Steps=Slider(10, range=0..10))
pt_3 = Point(Point(0.5087040954, 0.4892154751, -0.0007580647143))
pt_4 = ConstructPoint(XCoordinate=graft(range_3), YCoordinate=range_3, ZCoordinate=0)

dist = Distance(PointA=pt_4, PointB=pt_3)
Z = UnitZ(Factor=dist)
division = Division(A=dist, B="10")
addition = Addition(A=pt_4, B=Z)
cir = Circle(Plane=pt_4, Radius=division)
ln = Line(StartPoint=pt_4, EndPoint=addition)
extrcrv = ExtrudeAlong(Base=cir, Curve=ln)
cap = CapHoles(Brep=extrcrv)

brep = Brep(cap)
circle = Circle(cir)
line = Line(ln)

number_slider = Slider(1.012, range=0..10)
pi_3 = Pi(Factor=Slider(0.9027, range=0..2))

# ---- group: GH Equivalent
center_x_coord = Slider(0, range=0..100)
center_y_coord = Slider(0, range=0..100)
expression = Expression(b=center_y_coord, r=number_slider, t=pi_3, Expression="b + r * Sin(t)")
expression_2 = Expression(a=center_x_coord, r=number_slider, t=pi_3, Expression="a + r * Cos(t)")
pt_5 = ConstructPoint(XCoordinate=expression_2, YCoordinate=expression, ZCoordinate=0)

# ----
pt_6 = Point(pt_5)

# ---- group: GH Equivalent
space = Panel(" ")
concat = Concatenate(FragmentA="John", FragmentB=space, FragmentC="Smith")
fullname = Panel(concat)
concat_2 = Concatenate(FragmentA="Hello", FragmentB=space, FragmentC=concat, FragmentD="! Welcome to Python Programming!")

# ----
panel_8 = Panel(concat_2)
