# Grasshopper definition Day02-END.ghx (Grasshopper 1.0.7)
# Copyright: Alan Rynne

series = Series(Start=0, Step="0.1", Count=Slider(21, range=0..100))
pt = ConstructPoint(XCoordinate=graft(series), YCoordinate=series, ZCoordinate=0)  # -> simplify(Point)
pt_2 = Point([Point(0.3037832804, 0.474872937, -0.3378564818), Point(0.4721519081, 2.198995174, 0.506820065), Point(1.216226153, 0.9344408599, -0.271656236), Point(1.981215506, 0.6377761895, 0.1286148111), Point(1.230417757, -0.1119027715, 0.2289347743)])

# ---- group: Comparing numbers and formatting
python = GhPythonScript(number=Slider(4, range=0..10), compare=Slider(4, range=0..10))  # -> out
# ---------- python: Python ----------
import Rhino.Geometry as rg
# BOOLEAN VALUES, COMPARISONS AND CONDITIONALS

# Boolean values can be 'True' (notice capitalization)
boolean = True
print(boolean)

# or 'False'
boolean = False
print(boolean)

# You can make comparisons between values using '==' (two equal signs)
check = (boolean == False)
# A comparison will always return a boolean value.
print(check)

# You can think of comparisons as YES or NO questions:
# - Is this value equals to 'True'?
# - Is this value bigger than 5?
# - Is this point's Z coordinate bigger than 7.0?

# Other comparisons are available

# 'number' and 'compare' are inputs coming from GH
print('\t--> Comparing number {} with {} <--'.format(number,compare))

# Equality check
checkEqual = number == compare
print('{}\t--> Number {} equals to {}'.format(checkEqual,number, compare))

# Inequality check
checkEqual = number != compare
print('{}\t--> Number {} NOT equals to {}'.format(checkEqual,number, compare))

# Bigger than
checkBigger = number > compare
print('{}\t--> Number {} is bigger than {}'.format(checkBigger, number, compare))

# Bigger or equals than
checkBiggerEquals = number >= compare
print('{}\t--> Number {} is bigger or equals than {}'.format(checkBiggerEquals, number, compare))

# Smaller than
checkSmaller = number < compare
print('{}\t--> Number {} is smaller than {}'.format(checkSmaller, number, compare))

# Smaller or equals than
checkSmallerEquals = number <= compare
print('{}\t--> Number {} is smaller or equals than {}'.format(checkSmallerEquals, number, compare))


# You can also compare simple geometry entities (points, vectors...)
ptA = rg.Point3d(0,0,number)
ptB = rg.Point3d(0,0,compare)
checkPt = ptA == ptB
print('--> Comparing point {} to point {} <--'.format(ptA,ptB))
print('{} --> PointA is equal to PointB'.format(checkPt))

# Once you have a boolean value, you can 'negate' it by using the 'not()' function.
print(checkPt)
print(not(checkPt))
# ---------- end python ----------
panel = Panel(python)

# ---- group: Prev day exercise
range = Range(Domain=Domain(0, 1), Steps=Slider(10, range=0..10))
pt_3 = ConstructPoint(XCoordinate=graft(range), YCoordinate=range, ZCoordinate=0)
pt_4 = Point(Point(0.9634185682, 0.4892154751, 0.05846322429))
python_2 = GhPythonScript(point=pt_3, attractor=pt_4)  # -> out, circle, line, extrude; inputs point: Point3d, attractor: Point3d
# ---------- python_2: Python ----------
import Rhino.Geometry as rg

# We are going to create a simple 'attractor' exercise. 
# Given a point from a grid and an attractor point:

# 1. Get the distance between the point and the attractor
distance = point.DistanceTo(attractor)

# 2. Distance is usually too big to use as a radius, so divide by 10 (or whatever)
radius = distance / 10

# 3. Create a circle using point and ratio
circle = rg.Circle(point, radius)

# 4. Create a vector in the z direction
vector = rg.Vector3d.ZAxis * distance

# 5. Move the point using the prevously created vector
newPoint = point + vector

# 6. Create a line between both points
line = rg.Line(point,newPoint)

# TIP
# Sweep requires to inputs as 'Nurbs Curves', so we must convert the line and the circle first
axis = line.ToNurbsCurve()
profile = circle.ToNurbsCurve()

# 8. Create the sweep brep.
brep = rg.Brep.CreateFromSweep(axis,profile,False,0.01)[0]

# 8.1. Optionally closed the planar holes in the extrusion.
closedBrep = rg.Brep.CapPlanarHoles(brep,0.01)

# 9. Assign brep to output
extrude = closedBrep
# ---------- end python_2 ----------

# ----
panel_2 = Panel("""0
0.33
0.66""")
button = Button()  # disabled
addition = Addition(A=panel_2, B=Slider(1, range=0..1))

pi = Pi(Factor=Slider(0.07, range=0..1))
pt_5 = Point(Point(0.9319814938, 1.102701922, 0))
python_3 = GhPythonScript(point=pt, attractor=pt_5, maxRot=pi)  # -> out, shape, axis, sweep; inputs point: Point3d, attractor: Point3d
# ---------- python_3: Python ----------
import Rhino.Geometry as rg
import math
import random
distance = point.DistanceTo(attractor)

radius = .01 / distance
print(radius)

maxRadius = 0.045
minRadius = 0.02

# Lock the radius into a specific range
if(radius > maxRadius):
    radius = maxRadius

if(radius < minRadius):
    radius = minRadius
    
circle = rg.Circle(point,radius)

squarePlane = rg.Plane(point,rg.Vector3d.ZAxis)

ratio = (radius - minRadius) / (maxRadius - minRadius)
rot = ratio * maxRot

squarePlane.Rotate(rot,rg.Vector3d.ZAxis)

squareInterval = rg.Interval(-radius,radius)

square = rg.Rectangle3d(squarePlane,squareInterval,squareInterval)

shape = square
# ---------- end python_3 ----------

intcrv = Interpolate(Vertices=pt_2, Degree=3, Periodic=invert(False), KnotStyle=1)  # -> reparameterize(Curve), Length, Domain
timer = Timer(TimerInterval=100, Target=python_4)  # disabled
pi_2 = Pi(Factor=Slider(0.07, range=0..1))
panel_3 = Panel("0")  # disabled
panel_4 = Panel("0.01")  # disabled
mod = Modulus(A=addition, B="1")
python_4 = GhPythonScript(x=panel_3, y=panel_4, reset=button)  # -> out, a; disabled
# ---------- python_4: Python ----------
import scriptcontext


stickyval = 0
# restore stickyval if it has been saved
if scriptcontext.sticky.has_key("t-value"):
    stickyval = scriptcontext.sticky["t-value"]

if reset:
    a = 0
    scriptcontext.sticky["t-value"] = 0
else:
    a = stickyval
    # save the value for use in the future
    scriptcontext.sticky["t-value"] = (stickyval + y) % 1
# ---------- end python_4 ----------
colors = Relay([ColourSwatch(SwatchColor=RGB(0, 150, 143)), ColourSwatch(SwatchColor=RGB(255, 0, 0)), ColourSwatch(SwatchColor=RGB(0, 92, 138))])
dom = ConstructDomain(DomainStart=Slider(0.00884, range=0..0.05), DomainEnd=Slider(0.05, range=0..0.05))
eval = EvaluateCurve(Curve=intcrv.Curve, Parameter=mod)  # -> Point, Tangent, Angle
panel_5 = Panel(python_4.a)
python_5 = GhPythonScript(point=pt, attractors=pt_2, maxRot=pi_2, radiusRange=dom, ratio=Slider(0.1332, range=0..0.3), colorList=colors)  # -> out, shape, color, brep; inputs point: Point3d, attractors: list of Point3d, colorList: list of Point3d
# ---------- python_5: Python ----------
import Rhino.Geometry as rg
import Rhino.Display as rd
import math
import random

# 1. Get the closest attractor point

# 1.1 Create a point cloud from the attractors
cloud = rg.PointCloud(attractors)

# 1.2 Get the index of the closest point in the point cloud
attractorIndex = cloud.ClosestPoint(point)

# 1.3 Get the point in the attractors list at that index
attractor = attractors[attractorIndex]


# 2. Compute the distance from the attractor to this point

distance = point.DistanceTo(attractor)


# 3. Compute the radius

# 3.1 Divide the ratio / (distance * 10), this will make the attractor inverse.
radius = ratio / (distance * 10)

# 3.2 Prevent radius from being bigger or smaller than desired.
if(radius > radiusRange.Max):
    radius = radiusRange.Max
elif(radius < radiusRange.Min):
    radius = radiusRange.Min


# 4. Get the ratio of the radius in that range (number from 0 to 1).

radiusRatio = (radius - radiusRange.Min) / radiusRange.Length


# 5. Compute the rotation of the plane in radians

rot = radiusRatio * maxRot


# 6. Create a plane at the point and rotate it

plane = rg.Plane(point, rg.Vector3d.ZAxis)
plane.Rotate(math.sin(rot),math.cos(rot),plane.ZAxis)


# 7. Decide if you draw a circle or a square based on the radius value.

if(radius < 0.018 ):
    # Create a circle
    circle = rg.Circle(plane,radius)
    shape = circle
else:
    # Create a rectangle
    squareInterval = rg.Interval(-radius,radius)
    square = rg.Rectangle3d(plane,squareInterval,squareInterval)
    shape = square


# 8. Create brep from closed planar curve

# 8.1 Use an rg.Brep function to 'CreatePlanarBreps'
planarResult = rg.Brep.CreatePlanarBreps(shape.ToNurbsCurve(),0.01)

# 8.2'planarResult' is a LIST, so we get the first item and assign to output
brep = planarResult[0]


# 9. Compute a color based on the radius.

# 9.1 Create a curve from the color points
colorCrv = rg.NurbsCurve.CreateControlPointCurve(colorList,3)

# 9.2 Compute a color based on the radiusRatio and assign to output
color = colorCrv.PointAt(radiusRatio)
# ---------- end python_5 ----------
preview = CustomPreview(Geometry=python_5.brep, Material=python_5.color)
