# Grasshopper definition Day02-START.ghx (Grasshopper 1.0.7)
# Copyright: Alan Rynne

series = Series(Start=0, Step="0.1", Count=Slider(21, range=0..100))
range = Range(Domain=Domain(0, 1), Steps=10)
pt = ConstructPoint(XCoordinate=graft(series), YCoordinate=series, ZCoordinate=0)  # -> simplify(Point)
pt_2 = Point([Point(0.3037832804, 0.474872937, -0.3378564818), Point(0.4721519081, 2.198995174, 0.506820065), Point(1.216226153, 0.9344408599, -0.271656236), Point(1.981215506, 0.6377761895, 0.1286148111), Point(1.230417757, -0.1119027715, 0.2289347743)])

# ---- group: Comparing things
python = GhPythonScript(number=Slider(4, range=0..10), compare=Slider(4, range=0..10))  # -> out
# ---------- python: Python ----------
import Rhino.Geometry as rg

# BOOLEAN VALUES, COMPARISONS AND CONDITIONALS

# Boolean values can be 'True' (notice capitalization)

# or 'False'

# You can make comparisons between values using '==' (two equal signs)

# A comparison will always return a boolean value.

# You can think of comparisons as YES or NO questions:
# - Is this value equals to 'True'?
# - Is this value bigger than 5?
# - Is this point's Z coordinate bigger than 7.0?

# Other comparisons are available

# 'number' and 'compare' are inputs coming from GH

# Equality check

# Inequality check

# Bigger than

# Bigger or equals than

# Smaller than

# Smaller or equals than


# You can also compare simple geometry entities (points, vectors...)

# Once you have a boolean value, you can 'negate' it by using the 'not()' function.
# ---------- end python ----------
panel = Panel(python)

# ----
range_2 = Range(Domain=Domain(0, 1), Steps=Slider(10, range=0..10))
pt_3 = ConstructPoint(XCoordinate=graft(range_2), YCoordinate=range_2, ZCoordinate=0)
pt_4 = Point(Point(0.9634185682, 0.4892154751, 0.05846322429))
python_2 = GhPythonScript(point=pt_3, attractor=pt_4)  # -> out, circle, line, extrude; inputs point: Point3d, attractor: Point3d
# ---------- python_2: Python ----------
import Rhino.Geometry as rg

# We are going to create a simple 'attractor' exercise. 
# Given a point from a grid and an attractor point:

# 1. Get the distance between the point and the attractor
distance = point.DistanceTo(attractor)

# 2. Distance is usually too big to use as a radius, so divide by 10 (or whatever)

# 3. Create a circle using point and ratio
circle = rg.Circle(point, distance)

# 4. Create a vector in the z direction

# 5. Move the point using the prevously created vector

# 6. Create a line between both points

# TIP
# Sweep requires to inputs as 'Nurbs Curves', so we must convert the line and the circle first

# 8. Create the sweep brep.

# 8.1. Optionally closed the planar holes in the extrusion.

# 9. Assign brep to output
# ---------- end python_2 ----------

# ---- group: Inverse attractor
pi = Pi(Factor=Slider(0.07, range=0..1))
pt_5 = Point(Point(0.9319814938, 1.102701922, 0))
python_3 = GhPythonScript(point=pt, attractor=pt_5, maxRot=pi)  # -> out, shape, axis, sweep; inputs point: Point3d, attractor: Point3d
# ---------- python_3: Python ----------
import Rhino.Geometry as rg
import math
import random

# Get distance to point

# Modify distance to get a radius

# Set max and in radius

# Lock the radius into a specific range

# Create a plane for the square

# Compute the a number from 0 to 1 between the min and max radius

# Multiply ratio by max rotation to get current rotation

# Rotate plane

# Create an interval for the square

# Create the square

# Output
# ---------- end python_3 ----------

# ----
button = Button()  # disabled
timer = Timer(TimerInterval=100, Target=python_4)  # disabled
panel_2 = Panel("0")  # disabled
panel_3 = Panel("0.01")  # disabled
pi_2 = Pi(Factor=Slider(0.07, range=0..1))
python_4 = GhPythonScript(x=panel_2, y=panel_3, reset=button)  # -> out, a; disabled
# ---------- python_4: Python ----------
import scriptcontext


stickyval = 0
# restore stickyval if it has been saved
if scriptcontext.sticky.has_key("t-value"):
    stickyval = scriptcontext.sticky["t-value"]

if reset:
    a = 0
    scriptcontext.sticky["t-value"] = 0
else:
    a = stickyval
    # save the value for use in the future
    scriptcontext.sticky["t-value"] = (stickyval + y) % 1
# ---------- end python_4 ----------
colors = Relay([ColourSwatch(SwatchColor=RGB(0, 150, 143)), ColourSwatch(SwatchColor=RGB(255, 0, 0)), ColourSwatch(SwatchColor=RGB(0, 92, 138))])
dom = ConstructDomain(DomainStart=Slider(0.00884, range=0..0.05), DomainEnd=Slider(0.05, range=0..0.05))
panel_4 = Panel(python_4.a)
python_5 = GhPythonScript(point=pt, attractors=pt_2, maxRot=pi_2, radiusRange=dom, ratio=Slider(0.1332, range=0..0.3), colorList=colors)  # -> out, shape, color, brep; inputs point: Point3d, attractors: list of Point3d, colorList: list of Point3d
# ---------- python_5: Python ----------
import Rhino.Geometry as rg
import Rhino.Display as rd
import math
import random

# 1. Get the closest attractor point

# 1.1 Create a point cloud from the attractors
cloud = rg.PointCloud(attractors)

# 1.2 Get the index of the closest point in the point cloud
attractorIndex = cloud.ClosestPoint(point)

# 1.3 Get the point in the attractors list at that index
attractor = attractors[attractorIndex]


# 2. Compute the distance from the attractor to this point


# 3. Compute the radius

# 3.1 Divide the ratio / (distance * 10), this will make the attractor inverse.

# 3.2 Prevent radius from being bigger or smaller than desired.

# 4. Get the ratio of the radius in that range (number from 0 to 1).


# 5. Compute the rotation of the plane in radians


# 6. Create a plane at the point and rotate it


# 7. Decide if you draw a circle or a square based on the radius value.


# 8. Create brep from closed planar curve

# 8.1 Use an rg.Brep function to 'CreatePlanarBreps'

# 8.2'planarResult' is a LIST, so we get the first item and assign to output


# 9. Compute a color based on the radius.

# 9.1 Create a curve from the color points

# 9.2 Compute a color based on the radiusRatio and assign to output
# ---------- end python_5 ----------
preview = CustomPreview(Geometry=python_5.brep, Material=python_5.color)
