# Grasshopper definition Day03-END.gh (Grasshopper 1.0.7)

series = Series(Start=0, Step=1, Count=10)
panel = Panel(series)
pt = ConstructPoint(XCoordinate=series, YCoordinate=0, ZCoordinate=0)
number_slider = Slider(67, range=0..100)
entwine = Entwine(Branch00=panel, Branch01=panel, Branch02=panel, FlattenInputs=True)
pt_2 = Point([Point(1, -1, 0), Point(3.812654426, 1, -1.789832945), Point(5, -2, 2.302331232), Point(10, -2, 4.665588458), Point(9.919717531, 3.396872046, 4.295394091), Point(6, 2.542120353, 4.940317013), Point(6, 9, 0)])
intcrv = Interpolate(Vertices=pt_2, Degree=3, Periodic=False, KnotStyle=0)  # -> Curve, Length, Domain
python = GhPythonScript(x=pt_2, y=number_slider)  # -> out, curve, points, planes, movedPoints; inputs x: list of Point3d, y: Int32
# ---------- python: Python ----------
import Rhino.Geometry as rg
import math

print(x)

curve = rg.Curve.CreateInterpolatedCurve(x,3)
curve.Domain = rg.Interval(0,1) # Reparametrize curve

points = []
planes = []

for i in range( y+1 ):
    print("Starting iteration: {}".format(i))
    ratio = i / y;
    print(ratio)
    pt = curve.PointAt(ratio)
    plane = curve.PerpendicularFrameAt(ratio)[1]
    print(pt)
    points.append(pt)
    planes.append(plane)

# Class exercise.
# 1. Loop throught all the points in 'points' list
# 2. And add a Z vector to the point if the point Z > 3.
# 3. Add the new point to the list 'movedPoints'
movedPoints = []
for pt in points:
    if(pt.Z > 3):
        moved = pt + rg.Vector3d.ZAxis
        movedPoints.append(moved)


# Class exercise.
# 1. Loop through all the planes.
# 2. Try and rotate each plane by 15degrees each time.
count = 0
rotation = 0

# do something with each plane on the curve.
movedPoints = []
for plane in planes:
    print("rotating")
    totalDegrees = count * 100
    degreeRatio = totalDegrees / 360
    radianAngle = 2 * math.pi * degreeRatio
    print(radianAngle)
    plane.Rotate(radianAngle, plane.ZAxis)
    count = count + 1
    pt = plane.Origin + plane.XAxis
    movedPoints.append(pt)
# ---------- end python ----------

# ---- group: Lists in pytho n
python_2 = GhPythonScript()  # -> out, a
# ---------- python_2: Python ----------
import Rhino.Geometry as rg

list = [] # This is an empty list.
print(list)

list2 = [1,2,3,4]
print(list2)

# Get an item by index
item = list2[2]
print(item)

# Get a range of items.
itemRange = list2[0:3]
print(itemRange)

numberList = range(100)
print(numberList)

l = len(numberList) # Get the length of the list
print(l)

list.append("A") # This will add "A" to the list.
print(list)

list.pop() # Remove the last item in the list
print(list)

list.insert(0,"inserted") # Insert an object at an index.
print(list)

list.remove("inserted") # Remove a specific object from the list.
print(list)

list2.pop(2)
print(list2)
# ---------- end python_2 ----------
panel_2 = Panel(python_2.out)
panel_3 = Panel(python_2.a)

# ----
pframe = PerpFrame()
range = Range(Domain=Domain(0, 1), Steps=number_slider)
divide = DivideCurve(Curve=intcrv.Curve, Count=number_slider, Kinks=False)  # -> Points, Tangents, Parameters
pt_3 = Point(python.movedPoints)
pln = Plane(python.planes)
eval = EvaluateCurve(Curve=reparameterize(intcrv.Curve), Parameter=range)  # -> Point, Tangent, Angle
crv = Curve(python.curve)
intcrv_2 = Interpolate(Vertices=pt_3, Degree=3, Periodic=False, KnotStyle=1)  # -> Curve, Length, Domain
panel_4 = Panel(python.out)
