# Grasshopper definition Day03-Homework.gh (Grasshopper 1.0.7)
# plug-ins: Human

# PYTHON - DAY 03 - HOMEWORK
panel = Panel("0 to 10")
panel_2 = Panel("""32049823
5803459
2304234""")
panel_3 = Panel("""0
1
1""")
random = Random(Range=panel, Number=Slider(100, range=0..100), Seed=2)
jitter = Jitter(List=random, Jitter=panel_3, Seed=panel_2)  # -> Values, Indices
bang = ExplodeTree(Data=jitter.Values)  # -> Branch0, Branch1, Branch2
pt = Point(Point(0, 0, 0))
pt_2 = ConstructPoint(XCoordinate=bang.Branch0, YCoordinate=bang.Branch1, ZCoordinate=bang.Branch2)

# ---- group: Exercise 3
pt_3 = Point([Point(-12.36032909, -3.466787906, 0), Point(-2.671388129, -5.280263548, 0), Point(-3.516268641, 6.958667694, 0), Point(8.40013924, 4.580745286, 0), Point(7.760897759, 17.4029395, 0), Point(21.00968072, 14.78588272, 0), Point(19.29527537, 25.38620858, 0), Point(30.78831663, 26.78495761, 0)])
python = GhPythonScript(points=pt_3)  # -> out, diagonals, sideA, sideB; inputs points: list of Point3d
# ---------- python: Python ----------
import Rhino.Geometry as rg

# Making a truss

## Create the diagonals

## 1. Get the length of the 'points' input

## 2. Create a list of numbers from 1 to the count of points and loop through that list.
## Inside the loop, 
    ## get the point at the index corresponding to the current number and also the point with (index - 1).
    ## Create a line between both points
    ## Add the line to a list called 'diagonals', rename an output to the same.

## 3. Do the same for each of the sides of the truss.
## Put each side on a different list, 'sideA' and 'sideB', and rename two outputs to thesame.
# ---------- end python ----------

# ---- group: Exercise 4
python_2 = GhPythonScript()  # -> out, surface, beams, floorCurves
# ---------- python_2: Python ----------
# 1. Create the offset interval. Then you can use the interval function 'ParameterAt()' to compute the offset at a given point.

# 2. Create a list of as many planes as specified in 'floorCount'
    # Rotate the planes according to the current step and the maximum turns specified
    # Compute the offset at the given iteration.
    # Create two circles per plane, with radius equal to 'radius' and 'radius-offset' respectively
    # Create a list that will contain 6 points, 3 in the bigger circle and 3 in the smaller circle, alternating.
    # Create a CLOSED interpolated curve with those 6 points.
    # Add the curve to a list called 'floorCurves'.

# 3. Create a loft surface using all the floor curves.

# 4. Loop through the INDEXES of the floorCurves list.
    # Select the curve at the current index and the next one.
    # Create a loop for as many points specified in 'beamCount'
    # Create a point on each curve, the point at curve B should be one point over (not completelly vertical)
    # Create a line using both points.
    # Add the line to a list called 'beams'
# ---------- end python_2 ----------

# ---- group: Exercise 2
python_3 = GhPythonScript(pointsA=pt_2, pointsB=pt)  # -> out, pointA, pointB, indexA, indexB, distance; inputs pointsA: list of Point3d, pointsB: list of Point3d
# ---------- python_3: Python ----------
# Find the closest points between two different lists of points

# You cannot use the pointcloud class for this exercise.
# It must be done looping through the list of points.

# Very similar to the previous exercise.
# In this case, you have to loop over BOTH lists, and save:
    # The closest point in the list A 
    # and its index
    # The closest point in the list A 
    # and its index
    # The distance between both points.
# ---------- end python_3 ----------

# ---- group: Exercise 1
python_4 = GhPythonScript(points=pt_2, search=pt)  # -> out, closest, index, distance; inputs points: list of Point3d, search: Point3d
# ---------- python_4: Python ----------
# Find the closest point to the given point

# You cannot use the pointcloud class for this exercise.
# It must be done looping through the list of points.

# Tip, you might want to keep a variable for the closest point
# and another one for the current smallest distance.

# For every point, measure its distance to the search point.
# If the new distance is smaller than the current smallest...
# ... you found a point that is closer!
# ... Update your distance and point variables with the new values

# Modify your code to also be able to output the index of the closest point.
# Make sure to output the resulting point.
# ---------- end python_4 ----------
cp = ClosestPoint(Point=pt, Cloud=pt_2)  # -> ClosestPoint, CPIndex, Distance

# ---- group: Grasshopper Equivalent
floorcount = Slider(20, range=0..100)
turns = Slider(0.299, range=0..10)
beamcount = Slider(88, range=0..100)
maxoffset = Slider(1, range=0..1)
minoffset = Slider(0.28, range=0..1)
radius = Slider(3, range=0..10)

pt_4 = Point([Point(-12.36032909, -3.466787906, 0), Point(-2.671388129, -5.280263548, 0), Point(-3.516268641, 6.958667694, 0), Point(8.40013924, 4.580745286, 0), Point(7.760897759, 17.4029395, 0), Point(21.00968072, 14.78588272, 0), Point(19.29527537, 25.38620858, 0), Point(30.78831663, 26.78495761, 0)])
split = SplitTree(Data=pt_4, Masks=flatten("{*}[1,2,...]"))  # -> Positive, Negative
split_2 = SplitTree(Data=pt_4, Masks=flatten("{*}[2,4,...]"))  # -> Positive, Negative
split_3 = SplitTree(Data=pt_4, Masks=flatten("{*}[3,5,...]"))  # -> Positive, Negative
relitem2 = RelativeItems(TreeA=split.Positive, TreeB=pt_4, Offset="{0}[-1]", WrapPaths=False, WrapItems=False)  # -> ItemA, ItemB
relitem2_2 = RelativeItems(TreeA=split_2.Positive, TreeB=pt_4, Offset="{0}[-2]", WrapPaths=False, WrapItems=False)  # -> ItemA, ItemB
relitem2_3 = RelativeItems(TreeA=split_3.Positive, TreeB=pt_4, Offset="{0}[-2]", WrapPaths=False, WrapItems=False)  # -> ItemA, ItemB
ln = Line(StartPoint=relitem2.ItemA, EndPoint=relitem2.ItemB)
ln_2 = Line(StartPoint=relitem2_2.ItemA, EndPoint=relitem2_2.ItemB)
ln_3 = Line(StartPoint=relitem2_3.ItemA, EndPoint=relitem2_3.ItemB)
entwine = Entwine(Branch00=ln, Branch01=ln_2, Branch02=ln_3, FlattenInputs=True)
previewlw = CustomPreviewLineweights(
    Geometry=entwine,
    Shader=graft([ColourSwatch(SwatchColor=RGB(255, 0, 0)), ColourSwatch(SwatchColor=RGB(0, 115, 255)), ColourSwatch(SwatchColor=RGB(0, 255, 51))]),
    Thickness=Slider(4, range=0..10),
    Absolute=False)

# ---- group: Grasshopper Equivalent / Create the floor planes
pi = Pi(Factor=turns)
series = Series(Start=0, Step=1, Count=floorcount)
multiplication = Multiplication(A=pi, B=2)
Z = UnitZ(Factor=series)
range = Range(Domain=multiplication, Steps=expr("x-1", floorcount))
xy = XYPlane(Origin=Z)
rotate = Rotate(Geometry=xy, Angle=range, Plane=xy)  # -> Geometry, Transform

# ---- group: Grasshopper Equivalent
subtraction = Subtraction(A=radius, B=minoffset)
subtraction_2 = Subtraction(A=radius, B=maxoffset)
dom = ConstructDomain(DomainStart=subtraction, DomainEnd=subtraction_2)
range_2 = Range(Domain=dom, Steps=expr("x-1", floorcount))
ins = InsertItems(List=graft(range_2), Item=radius, Indices="0", Wrap=True)  # -> simplify(List)
cir = Circle(Plane=graft(rotate.Geometry), Radius=ins)

# ---- group: Grasshopper Equivalent / Get parameters for inner and outer circle points
division = Division(A="1", B="6")
division_2 = Division(A="6", B=2)
multiplication_2 = Multiplication(A=division, B=2)
series_2 = Series(Start=0, Step=multiplication_2, Count=division_2)
series_3 = Series(Start=division, Step=multiplication_2, Count=division_2)

# ---- group: Grasshopper Equivalent / Create a list alternating a point in the inner circle and a point in the outer circle. Interpolate those points
item = ListItem(List=cir, Index=0, Wrap=True)  # -> Item, Item1
eval = EvaluateCurve(Curve=reparameterize(item.Item1), Parameter=series_3)  # -> Point, Tangent, Angle
eval_2 = EvaluateCurve(Curve=reparameterize(item.Item), Parameter=series_2)  # -> Point, Tangent, Angle
weave = Weave(Pattern=[0, 1], Stream0=eval_2.Point, Stream1=eval.Point, NullGaps=False)
intcrv = Interpolate(Vertices=weave, Degree=3, Periodic=invert(False), KnotStyle=1)  # -> reparameterize(simplify(flatten(Curve))), Length, Domain

# ---- group: Grasshopper Equivalent / Step 3 - Compute the diagonal lines
range_3 = Range(Domain=Domain(0, 1), Steps=beamcount)
cull_i = CullIndex(List=range_3, Indices="-1", Wrap=True)
eval_3 = EvaluateCurve(Curve=graft(intcrv.Curve), Parameter=cull_i)  # -> simplify(Point), Tangent, Angle
relitem = RelativeItem(Tree=eval_3.Point, Offset="{+1}[+1]", WrapPaths=False, WrapItems=invert(False))  # -> ItemA, ItemB

# ---- group: Grasshopper Equivalent / Outputs
ln_4 = Line(StartPoint=flatten(relitem.ItemA), EndPoint=flatten(relitem.ItemB))
crv = Curve(intcrv.Curve)
loft = Loft(Curves=intcrv.Curve, Options={Adjust=False, Closed=False, LoftEnds=0, LoftSimp=0, LoftType=0, Rebuild=10, Refit=0.01})
